# Dynamo graph SheetCreation.dyn (Dynamo 2.19.3.6394)

file_path = Filename("C:\DynamoReports\SheetCreationData.xlsx")
string = StringInput("Sheets")
number = DoubleInput(0)
number_2 = DoubleInput(0)
file_path_2 = Filename("C:\DynamoReports\Sheets.xlsx")
file_from_path = FileObject(path=file_path_2)
string_2 = StringInput("Sheets")
importExcel = Data.ImportExcel(file=file_from_path, sheetName=string_2)
python_script = Python(IN[0]=importExcel)  # CPython3
# ---------- python_script.python (129 lines) ----------
import clr

clr.AddReference("RevitServices")
from RevitServices.Persistence import DocumentManager
from RevitServices.Transactions import TransactionManager

clr.AddReference("RevitAPI")
from Autodesk.Revit.DB import (
    FilteredElementCollector,
    BuiltInCategory,
    ViewSheet,
    View,
    Viewport,
    XYZ
)

doc = DocumentManager.Instance.CurrentDBDocument
excel_data = IN[0]

report = [["Sheet Number", "Sheet Name", "View Name", "X", "Y", "Status", "Message"]]

title_blocks = (
    FilteredElementCollector(doc)
    .OfCategory(BuiltInCategory.OST_TitleBlocks)
    .WhereElementIsElementType()
    .ToElements()
)

if len(title_blocks) == 0:
    report.append(["", "", "", "", "", "ERROR", "No title block type found"])
    OUT = report

else:
    title_block_id = title_blocks[0].Id

    def get_existing_sheet(sheet_number):
        sheets = FilteredElementCollector(doc).OfClass(ViewSheet).ToElements()
        for sheet in sheets:
            if sheet.SheetNumber == sheet_number:
                return sheet
        return None

    def get_view_by_name(view_name):
        views = FilteredElementCollector(doc).OfClass(View).ToElements()
        for view in views:
            if view.Name == view_name and not view.IsTemplate and view.CanBePrinted:
                return view
        return None

    def is_view_already_placed(view):
        viewports = FilteredElementCollector(doc).OfClass(Viewport).ToElements()
        for viewport in viewports:
            if viewport.ViewId == view.Id:
                return True
        return False

    rows = excel_data[1:]

    TransactionManager.Instance.EnsureInTransaction(doc)

    for row in rows:

        sheet_number = str(row[0]).strip() if len(row) > 0 and row[0] else ""
        sheet_name = str(row[1]).strip() if len(row) > 1 and row[1] else ""
        view_name = str(row[2]).strip() if len(row) > 2 and row[2] else ""

        x = float(row[3]) if len(row) > 3 and row[3] else 1
        y = float(row[4]) if len(row) > 4 and row[4] else 1

        if sheet_number == "":
            report.append([sheet_number, sheet_name, view_name, x, y, "ERROR", "Empty sheet number"])
            continue

        if sheet_name == "":
            report.append([sheet_number, sheet_name, view_name, x, y, "ERROR", "Empty sheet name"])
            continue

        if view_name == "":
            report.append([sheet_number, sheet_name, view_name, x, y, "ERROR", "Empty view name"])
            continue

        sheet = get_existing_sheet(sheet_number)

        if sheet is None:
            try:
                sheet = ViewSheet.Create(doc, title_block_id)
                sheet.SheetNumber = sheet_number
                sheet.Name = sheet_name
                sheet_message = "Sheet created"
            except Exception as e:
                report.append([sheet_number, sheet_name, view_name, x, y, "ERROR", "Could not create sheet: " + str(e)])
                continue
        else:
            sheet_message = "Existing sheet used"

        view = get_view_by_name(view_name)

        if view is None:
            report.append([sheet_number, sheet_name, view_name, x, y, "ERROR", "View not found"])
            continue

        if is_view_already_placed(view):
            report.append([sheet_number, sheet_name, view_name, x, y, "SKIPPED", "View already placed on another sheet"])
            continue

        try:
            Viewport.Create(
                doc,
                sheet.Id,
                view.Id,
                XYZ(x, y, 0)
            )

            report.append([
                sheet_number,
                sheet_name,
                view_name,
                x,
                y,
                "PLACED",
                sheet_message + " | View placed successfully"
            ])

        except Exception as e:
            report.append([sheet_number, sheet_name, view_name, x, y, "ERROR", "Could not place view: " + str(e)])

    TransactionManager.Instance.TransactionTaskDone()

    OUT = report
# ----------------------------------------
exportToExcel = Data.ExportToExcel(filePath=file_path, sheetName=string, startRow=number, startColumn=number_2, data=python_script)
